# Grasshopper definition DefMaster.gh (Grasshopper 0.9.75)
# plug-ins: Python Interpreter

update = Button()
c_script = CSharpScript(x=update)  # -> out, C, E, A
# ---------- c_script: C# ----------
    if(GrasshopperDocument.IsFilePathDefined){
      C = GrasshopperDocument.FilePath;

      System.IO.FileInfo info = new System.IO.FileInfo(GrasshopperDocument.FilePath);
      E = info.Name;
      A = info.DirectoryName;
    } else {
      C = "Unsaved Document";
    }
# ---------- end c_script ----------
format = Format(Format="{0}\launch.receipt", Culture=127, Data0=c_script.A)
writeresults = WriteResults(data="it launched dude", y=format)
southglzratio = Slider(0.7, range=0..1)
# Parameters
height = Slider(31, range=20..40)
taper = Slider(-0.6, range=-0.6..0.4)
brep = Brep([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])
ladybug = Ladybug_Ladybug()  # -> Vviiiiiiiiiizzz; plug-in component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
honeybee = Honeybee_Honeybee()  # -> Vviiiiiiiiiizzz; plug-in component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
crv = Curve([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])
lng = ListLength(List=writeresults)
format_2 = Format(Format="{0}\{1}", Culture=127, Data0=c_script.A, Data1="ParamSet.json")
preview = CustomPreview(Geometry=brep, Shader=ColourSwatch(SwatchColor=RGBA(186, 186, 186, 159)))
preview_2 = CustomPreview(Geometry=crv, Shader=ColourSwatch(SwatchColor=RGB(0, 0, 0)))
dispatch = Dispatch(List=format_2, DispatchPattern=lng)  # -> ListA, ListB
format_3 = Format(Format="{0}\done.receipt", Culture=127, Data0=c_script.A)
file = ReadFile(File=dispatch.ListA, PerLineParse=True)
readjson = PythonScript(x=file)  # -> out, a, b
# ---------- readjson: Python ----------
import json
dict = json.loads(x)
keys = []
vals = []
for key in dict:
     keys.append(key)
     vals.append(dict[key])
a = keys
b = vals
# ---------- end readjson ----------
panel = Panel(readjson.a)
item = ListItem(List=readjson.b, Index=0, Wrap=True)  # -> Item, Item1, Item2
pt = Point(Point(11.44104369, 2.352967986, 0))
vec = Vector(Vector(-8.845523185, 4.599579565, 0))
southglzratio_2 = Number(item.Item)
height_2 = Number(item.Item1)
taper_2 = Number(item.Item2)
pow = Power(A="3", B=2)
multiplication = Multiplication(A=pow, B=height_2)
pl = ConstructPlane(Origin=pt, XAxis=vec, YAxis=Vector(0, 1, 0))
division = Division(A=1000, B=multiplication)
multiplication_2 = Multiplication(A="3", B=division)
neg = Negative(Value=multiplication_2)
rectangle = Rectangle(Plane=pl, XSize=multiplication_2, YSize=neg, Radius=0)  # -> Rectangle, Length
pt_2 = ConstructPoint(XCoordinate=0, YCoordinate=0, ZCoordinate=height_2)
area = Area(Geometry=rectangle.Rectangle)  # -> Area, Centroid
move = Move(Geometry=rectangle.Rectangle, Motion=pt_2)  # -> Geometry, Transform
addition = Addition(A=taper_2, B=1)
area_2 = Area(Geometry=move.Geometry)  # -> Area, Centroid
subtraction = Subtraction(A=1, B=taper_2)
scale = Scale(Geometry=move.Geometry, Center=area_2.Centroid, Factor=subtraction)  # -> Geometry, Transform
scale_2 = Scale(Geometry=rectangle.Rectangle, Center=area.Centroid, Factor=addition)  # -> Geometry, Transform
loft = Loft(
    Curves=[scale_2.Geometry, scale.Geometry],
    Options={Adjust=False, Closed=False, LoftEnds=0, LoftSimp=0, LoftType=0, Rebuild=10, Refit=0.01})
cap = CapHoles(Brep=loft)
bbox = BoundingBox(Content=cap, Plane=PlaneXY(0, 0, 0))  # -> Box, Box_2
panel_2 = Panel("@3")  # disabled
panel_3 = Panel("@2")  # disabled
toggle = BooleanToggle(True)  # disabled
python = PythonScript(bldgMasses=cap, bldgsFlr2FloorHeights=panel_2, perimeterZoneDepth=panel_3, runIt=toggle)  # -> out, splitBldgMasses; disabled; plug-in component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
zbb = ZoomBoundingBox(box=bbox.Box, run=Toggle(True))  # -> out, A; inputs box: Box, run: Boolean
# ---------- zbb: C# ----------
    if(run){
      doc.Views.ActiveView.ActiveViewport.ZoomBoundingBox(box.BoundingBox); 
    }
# ---------- end zbb ----------
mass2zone = Honeybee_Masses2Zones(bldgMasses=flatten(cap), bldgsFlr2FlrHeights=flatten("@4"), maximumRoofAngle=30, createHoneybeeZones=Toggle(True))  # -> readMe, HBZones; plug-in component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
glzparamlist = Honeybee_GlazingParametersList(northGlzRatio="0.4", westGlzRatio="0.4", southGlzRatio=southglzratio_2, eastGlzRatio="0.4")  # -> readMe, glzRatioList, windowHeightList, sillHeightList; plug-in component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
solveadjc = Honeybee_SolveAdjacencies(HBZones=flatten(mass2zone.HBZones), findAdjc=Toggle(True))  # -> readMe, HBZonesWADJ; plug-in component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
glazingcreator = Honeybee_GlazingBasedOnRatio(HBObjects=flatten(solveadjc.HBZonesWADJ), glzRatio=flatten(glzparamlist.glzRatioList), runIt=Toggle(True))  # -> readMe, HBObjWGLZ; plug-in component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
decomposebytype = Honeybee_DecomposeBasedOnType(HBZone=flatten(glazingcreator.HBObjWGLZ))  # -> walls, windows, skylights, roofs, floors, ceilings, airWalls, shadings; plug-in component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
pan = Panel("C:/Data/")
lng_2 = ListLength(List=flatten([decomposebytype.walls, decomposebytype.windows, decomposebytype.roofs, decomposebytype.floors]))
c_script_2 = CSharpScript(x=lng_2, y=zbb.A)  # -> out, A
# ---------- c_script_2: C# ----------
    List<object> os = new List<object>();
    Bitmap bmp = RhinoDocument.Views.ActiveView.CaptureToBitmap(new Size(400, 400));
    A = Convert.ToBase64String(ImageToByte(bmp));
# ---------- c_script_2: C# additional code ----------
  public static byte[] ImageToByte(Image img)
  {
    ImageConverter converter = new ImageConverter();
    return (byte[]) converter.ConvertTo(img, typeof(byte[]));
  }
# ---------- end c_script_2 ----------
area_3 = Area(Geometry=decomposebytype.floors)  # -> Area, Centroid
area_4 = Area(Geometry=decomposebytype.roofs)  # -> Area, Centroid
area_5 = Area(Geometry=decomposebytype.windows)  # -> Area, Centroid
pan_2 = Panel("""wall area
window area
roof area
floor area
capture""")
area_6 = Area(Geometry=decomposebytype.walls)  # -> Area, Centroid
ma = MassAddition(Input=flatten(area_3.Area))  # -> Result, PartialResults
ma_2 = MassAddition(Input=flatten(area_4.Area))  # -> Result, PartialResults
ma_3 = MassAddition(Input=flatten(area_5.Area))  # -> Result, PartialResults
ma_4 = MassAddition(Input=flatten(area_6.Area))  # -> Result, PartialResults
merge = Merge(Data2=flatten("faceLength"), Data3="capture")
merge_2 = Merge(
    Data1=flatten(ma_4.Result),
    Data2=flatten(ma_3.Result),
    Data3=flatten(ma_2.Result),
    Data4=flatten(ma.Result),
    Data5=flatten(c_script_2.A))
preview_3 = CustomPreview(Geometry=decomposebytype.floors, Shader=ColourSwatch(SwatchColor=RGBA(230, 129, 129, 226)))
preview_4 = CustomPreview(Geometry=decomposebytype.walls, Shader=ColourSwatch(SwatchColor=RGBA(255, 255, 120, 226)))
preview_5 = CustomPreview(Geometry=decomposebytype.windows, Shader=ColourSwatch(SwatchColor=RGBA(120, 226, 255, 116)))
preview_6 = CustomPreview(Geometry=decomposebytype.roofs, Shader=ColourSwatch(SwatchColor=RGBA(89, 89, 89, 226)))
mkdict = PythonScript(x=pan_2, y=merge_2)  # -> out, a, b; inputs x: list, y: list
# ---------- mkdict: Python ----------
import json
dict = {}
for i,j in zip(x,y):
    dict[i] = j
arrDict = [dict]
a = arrDict
b = json.dumps(dict)
# ---------- end mkdict ----------
writeresults_2 = WriteResults(x=zbb.A, data=mkdict.b, y=format_3)

# ==== cluster WriteResults
y = ClusterInput()
x = ClusterInput()
data = ClusterInput()
writetexttofile = CSharpScript(x=x, data=data, y=y)  # -> out, A; inputs x: tree, data: list of String, y: String
# ---------- writetexttofile: C# ----------
    string folderPath = Path.GetDirectoryName(y);
    if(!System.IO.Directory.Exists(folderPath)){
      System.IO.Directory.CreateDirectory(folderPath);
    }
    using (System.IO.StreamWriter file = new System.IO.StreamWriter(y))
    {
      foreach (string line in data)
      {

        file.WriteLine(line);

      }
    }
# ---------- end writetexttofile ----------
A = ClusterOutput(writetexttofile.A)
