# Grasshopper definition MakeJsonParameterSet.gh (Grasshopper 0.9.75)
# plug-ins: Python Interpreter, SustainForGH

minimum_airflow_at_terminal_box = Slider(1, range=0..1)
lighting_power_density = Slider(1, range=0..1)
plug_load_power_density = Slider(1, range=0..1)
panel = Panel("C:\Users\Andheum\Desktop\Macro\DefMaster.gh")
bslider = BatchSlider(BatchVariable=plug_load_power_density, Steps=5)
bslider_2 = BatchSlider(BatchVariable=minimum_airflow_at_terminal_box, Steps=5)
bslider_3 = BatchSlider(BatchVariable=lighting_power_density, Steps=5)
getconnectedsliders = CSharpScript(x=[plug_load_power_density, lighting_power_density, minimum_airflow_at_terminal_box])  # -> out, A, B; inputs x: tree
# ---------- getconnectedsliders: C# ----------
    List<string> sliderList = new List<string>();
    foreach(GH_DocumentObject obj in GrasshopperDocument.Objects) {
      if(obj is GH_ActiveObject){
        GH_ActiveObject act = obj as GH_ActiveObject;
        Grasshopper.Kernel.Special.GH_NumberSlider slider = obj as Grasshopper.Kernel.Special.GH_NumberSlider;
        if (slider != null){
          if(this.Component.DependsOn(act)){
            sliderList.Add(slider.NickName);
          }
        }
      }
    }
    A = sliderList;
    B = x;
# ---------- end getconnectedsliders ----------
batchdriver = BatchDriver(
    Run=Toggle(False),
    FilePath="C:\Users\Andheum\Desktop\testout",
    Name="Pollinator",
    ValuesA=bslider,
    ValuesB=bslider_3,
    ValuesC=bslider_2)  # -> Path, ValuesA, ValuesB, ValuesC
merge = Merge(Data1=batchdriver.ValuesA, Data2=batchdriver.ValuesB, Data3=batchdriver.ValuesC)
format = Format(Format="{0}.json", Culture=127, Data0=batchdriver.Path)
mkdict = PythonScript(x=getconnectedsliders.A, y=merge)  # -> out, a, b; inputs x: list, y: list
# ---------- mkdict: Python ----------
import json
dict = {}
for i,j in zip(x,y):
    dict[i] = j
arrDict = [dict]
a = arrDict
b = json.dumps(dict)
# ---------- end mkdict ----------
writeresults = WriteResults(data=mkdict.b, y=format)

# ==== cluster WriteResults
y = ClusterInput()
x = ClusterInput()
data = ClusterInput()
writetexttofile = CSharpScript(x=x, data=data, y=y)  # -> out, A; inputs x: tree, data: list of String, y: String
# ---------- writetexttofile: C# ----------
    string folderPath = Path.GetDirectoryName(y);
    if(!System.IO.Directory.Exists(folderPath)){
      System.IO.Directory.CreateDirectory(folderPath);
    }
    using (System.IO.StreamWriter file = new System.IO.StreamWriter(y))
    {
      foreach (string line in data)
      {

        file.WriteLine(line);

      }
    }
# ---------- end writetexttofile ----------
A = ClusterOutput(writetexttofile.A)
