# Grasshopper definition ReadImgFromJson.gh (Grasshopper 0.9.75)
# plug-ins: Python Interpreter, HDTReference

panel = Panel("C:\Data\DefMaster_results.json")
dir = DirectoryContents(FolderPath="C:\Users\Andheum\Documents\pollinator\pollinate\Run", Filter="*receipt.json", IncludeSubfolders=True)  # -> FilePaths, FileNames
list = ItemSelector(
    dir.FilePaths,
    {"C:\Users\Andheum\Documents\pollinator\pollinate\Run\Processor_0\results\receipt.json", "C:\Users\Andheum\Documents\pollinator\pollinate\Run\Processor_1\results\receipt.json", "C:\Users\Andheum\Documents\pollinator\pollinate\Run\Processor_2\results\receipt.json", "C:\Users\Andheum\Documents\pollinator\pollinate\Run\Processor_3\results\receipt.json", "C:\Users\Andheum\Documents\pollinator\pollinate\Run\Processor_4\results\receipt.json", "C:\Users\Andheum\Documents\pollinator\pollinate\Run\Processor_5\results\receipt.json", "C:\Users\Andheum\Documents\pollinator\pollinate\Run\Processor_6\results\receipt.json", "C:\Users\Andheum\Documents\pollinator\pollinate\Run\Processor_7\results\receipt.json"}, selected="C:\Users\Andheum\Documents\pollinator\pollinate\Run\Processor_7\results\receipt.json")
file = ReadFile(File=list, PerLineParse=True)
readjson = PythonScript(x=file)  # -> out, a, b
# ---------- readjson: Python ----------
import json
dict = json.loads(x)
keys = []
vals = []
for key in dict:
     keys.append(key)
     vals.append(dict[key])
a = keys
b = vals
# ---------- end readjson ----------
srf = Srf(<srf referenced from the Rhino model>)
fsim = FindSimilarMember(Data="capture", Set=readjson.a)  # -> Hit, Index
item = ListItem(List=readjson.b, Index=fsim.Index, Wrap=True)
c_script = CSharpScript(x=item)  # -> out, A; inputs x: String
# ---------- c_script: C# ----------
    byte[] array = Convert.FromBase64String(x);
    System.ComponentModel.TypeConverter tc = System.ComponentModel.TypeDescriptor.GetConverter(typeof(Bitmap));
    Bitmap bitmap1 = (Bitmap) tc.ConvertFrom(array);
    string saveDir = @"C:\data\imgTest.jpg";
    bitmap1.Save(saveDir);
    A = saveDir;
# ---------- end c_script ----------
previewmat = CustomPreviewMaterials(Geometry=srf, DiffuseColor=RGB(255, 255, 255), DiffuseBitmap=c_script.A)
previewmat_2 = CustomPreviewMaterials(DiffuseColor=RGB(255, 255, 255))
