# Grasshopper definition Parameterized File.gh (Grasshopper 0.9.72)
# plug-ins: Python Interpreter

# Parameters
height = Slider(31, range=20..40)
taper = Slider(-0.2, range=-0.6..0.4)
ladybug = Ladybug_Ladybug()  # -> Vviiiiiiiiiizzz; plug-in component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
brep = Brep([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])
honeybee = Honeybee_Honeybee()  # -> Vviiiiiiiiiizzz; plug-in component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
crv = Curve([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])
preview = CustomPreview(Geometry=brep, Shader=ColourSwatch(SwatchColor=RGBA(186, 186, 186, 159)))
preview_2 = CustomPreview(Geometry=crv, Shader=ColourSwatch(SwatchColor=RGB(0, 0, 0)))
pt = Point(Point(11.44104369, 2.352967986, 0))
vec = Vector(Vector(-8.845523185, 4.599579565, 0))
pow = Power(A="3", B=2)
multiplication = Multiplication(A=pow, B=height)
pl = ConstructPlane(Origin=pt, XAxis=vec, YAxis=Vector(0, 1, 0))
division = Division(A=1000, B=multiplication)
multiplication_2 = Multiplication(A="3", B=division)
neg = Negative(Value=multiplication_2)
rectangle = Rectangle(Plane=pl, XSize=multiplication_2, YSize=neg, Radius=0)  # -> Rectangle, Length
pt_2 = ConstructPoint(XCoordinate=0, YCoordinate=0, ZCoordinate=height)
area = Area(Geometry=rectangle.Rectangle)  # -> Area, Centroid
move = Move(Geometry=rectangle.Rectangle, Motion=pt_2)  # -> Geometry, Transform
addition = Addition(A=taper, B=1)
area_2 = Area(Geometry=move.Geometry)  # -> Area, Centroid
subtraction = Subtraction(A=1, B=taper)
scale = Scale(Geometry=move.Geometry, Center=area_2.Centroid, Factor=subtraction)  # -> Geometry, Transform
scale_2 = Scale(Geometry=rectangle.Rectangle, Center=area.Centroid, Factor=addition)  # -> Geometry, Transform
loft = Loft(
    Curves=[scale_2.Geometry, scale.Geometry],
    Options={Adjust=False, Closed=False, LoftEnds=0, LoftSimp=0, LoftType=0, Rebuild=10, Refit=0.01})
cap = CapHoles(Brep=loft)
python = PythonScript(bldgMasses=cap, bldgsFlr2FloorHeights="@3", perimeterZoneDepth="@2", runIt=Toggle(True))  # -> out, splitBldgMasses; plug-in component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
mass2zone = Honeybee_Masses2Zones(bldgMasses=flatten(cap), bldgsFlr2FlrHeights=flatten("@4"), maximumRoofAngle=30, createHoneybeeZones=Toggle(True))  # -> readMe, HBZones; plug-in component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
glzparamlist = Honeybee_GlazingParametersList(northGlzRatio="0.4", westGlzRatio="0.4", southGlzRatio=Slider(0.7, range=0..1), eastGlzRatio="0.4")  # -> readMe, glzRatioList, windowHeightList, sillHeightList; plug-in component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
solveadjc = Honeybee_SolveAdjacencies(HBZones=flatten(mass2zone.HBZones), findAdjc=Toggle(True))  # -> readMe, HBZonesWADJ; plug-in component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
glazingcreator = Honeybee_GlazingBasedOnRatio(HBObjects=flatten(solveadjc.HBZonesWADJ), glzRatio=flatten(glzparamlist.glzRatioList), runIt=Toggle(True))  # -> readMe, HBObjWGLZ; plug-in component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
decomposebytype = Honeybee_DecomposeBasedOnType(HBZone=flatten(glazingcreator.HBObjWGLZ))  # -> walls, windows, skylights, roofs, floors, ceilings, airWalls, shadings; plug-in component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
preview_3 = CustomPreview(Geometry=decomposebytype.floors, Shader=ColourSwatch(SwatchColor=RGBA(230, 129, 129, 226)))
preview_4 = CustomPreview(Geometry=decomposebytype.walls, Shader=ColourSwatch(SwatchColor=RGBA(255, 255, 120, 226)))
preview_5 = CustomPreview(Geometry=decomposebytype.windows, Shader=ColourSwatch(SwatchColor=RGBA(120, 226, 255, 116)))
preview_6 = CustomPreview(Geometry=decomposebytype.roofs, Shader=ColourSwatch(SwatchColor=RGBA(89, 89, 89, 226)))
